% Simulink data dictionary data_dictionary1.sldd

T_env = 293.15
T_final = 294.1755
T_init = 293.1755
T_steam = 403.15
Ts = 0.1
flow_final = 0.18
flow_init = 0.0058
p_env = 101.325
p_init = 101.325
phi_env = 0.1
phi_final = 0.6
phi_init = 0.4987
pipe_cross_sectional_area1 = 20.2683
pipe_cross_sectional_area2 = 20.2683
pipe_cross_sectional_area3 = 20.2683
pipe_hydraulic_diameter1 = 5.08
pipe_hydraulic_diameter2 = 5.08
pipe_hydraulic_diameter3 = 5.08
pipe_length1 = 1
pipe_length2 = 1
pipe_length3 = 1
specific_heat1 = 447
specific_heat2 = 447
specific_heat3 = 447
specific_heat4 = 447
specific_heat5 = 447
stop_time = 8000
thermal_mass1 = 1
thermal_mass2 = 1
thermal_mass3 = 1
thermal_mass4 = 1
thermal_mass5 = 1
u_steam_init = 0
u_volts_fan_init = 1
u_volts_heater_init = 0